# Grasshopper definition GH_Robots_OffsetWall.gh (Grasshopper 1.0.8)
# plug-ins: Robots

# Project: Continuous Toolpath Generator for Lattice Structures
# Author: Wouter A. van Hest
# License: GNU General Public License v3.0 (GPLv3)
# © 2025 Wouter A. van Hest
# 
# This script is open-source and distributed under the GNU GPLv3.
# See the LICENSE file in the GitHub repository for full terms.
number_slider = Slider(25, range=0..100)
square = Square(Plane=PlaneXY(0, 0, 0), Size=1, ExtentX=number_slider, ExtentY=number_slider)  # -> Cells, Points
bounding_box = BoundingBox(Content=flatten(square.Cells), Plane=PlaneXY(0, 0, 0), UnionBox=True)  # -> Box, Box_2
deconstruct_brep = DeconstructBrep(Brep=bounding_box.Box)  # -> Faces, Edges, Vertices
surface = Surface(<surface referenced from the Rhino model>)
list_item = ListItem(List=deconstruct_brep.Faces, Index=0, Wrap=True)
map_to_surface = MapToSurface(Curve=square.Cells, Source=list_item, Target=surface)  # -> flatten(Curve)
discontinuity = Discontinuity(Curve=map_to_surface, Level=1)  # -> Points, Parameters
surface_closest_point = SurfaceClosestPoint(Point=discontinuity.Points, Surface=surface)  # -> Point, UVPoint, Distance
evaluate_surface = EvaluateSurface(Surface=surface, Point=surface_closest_point.UVPoint)  # -> Point, Normal, UDirection, VDirection, Frame
deconstruct_vector = DeconstructVector(Vector=evaluate_surface.Normal)  # -> XComponent, YComponent, ZComponent
vector_xyz = VectorXYZ(XComponent=deconstruct_vector.XComponent, YComponent=deconstruct_vector.YComponent, ZComponent=0)  # -> Vector, Length
amplitude = Amplitude(Vector=vector_xyz.Vector, Amplitude=Slider(20, range=0..100))
move = Move(Geometry=evaluate_surface.Point, Motion=amplitude)  # -> Geometry, Transform
number_slider_2 = Slider(20, range=0..100)
flip_matrix = FlipMatrix(Data=discontinuity.Points)
flip_matrix_2 = FlipMatrix(Data=move.Geometry)
explode_tree = ExplodeTree(Data=flip_matrix)  # -> Branch0, Branch1, Branch2, Branch3
explode_tree_2 = ExplodeTree(Data=flip_matrix_2)  # -> Branch0, Branch1, Branch2, Branch3
center_box = CenterBox(Base=PlaneXY(0, 0, 0), X=number_slider_2, Y=number_slider_2, Z=number_slider_2)
panel = Panel("""2
1
6
5
3
7
6
2
3
1""")
deconstruct_brep_2 = DeconstructBrep(Brep=center_box)  # -> Faces, Edges, Vertices
twisted_box = TwistedBox(
    CornerA=explode_tree.Branch0,
    CornerB=explode_tree.Branch1,
    CornerC=explode_tree.Branch2,
    CornerD=explode_tree.Branch3,
    CornerE=explode_tree_2.Branch0,
    CornerF=explode_tree_2.Branch1,
    CornerG=explode_tree_2.Branch2,
    CornerH=explode_tree_2.Branch3)
list_item_2 = ListItem(List=deconstruct_brep_2.Vertices, Index=panel, Wrap=True)
polyline = PolyLine(Vertices=list_item_2, Closed=False)
box_morph = BoxMorph(Geometry=polyline, Reference=center_box, Target=twisted_box)  # -> reverse(Geometry)
partition_list = PartitionList(List=box_morph, Size=number_slider)
curve = Curve(reverse(partition_list))
flip_matrix_3 = FlipMatrix(Data=partition_list)
flip_matrix_4 = FlipMatrix(Data=curve)
dispatch = Dispatch(List=flip_matrix_3, DispatchPattern=[True, False])  # -> ListA, ListB
dispatch_2 = Dispatch(List=flip_matrix_4, DispatchPattern=[True, False])  # -> ListA, ListB
weave = Weave(Pattern=[0, 1], Stream0=dispatch.ListA, Stream1=dispatch_2.ListB, NullGaps=False)
flip_matrix_5 = FlipMatrix(Data=weave)  # -> flatten(Data)
control_points = ControlPoints(Curve=flip_matrix_5)  # -> flatten(Points), Weights, Knots
point = Point(<point referenced from the Rhino model>)
brep = Brep([<brep referenced from the Rhino model> x4])
xy_plane = XYPlane(Origin=control_points.Points)
yz_plane = YZPlane(Origin=point)
mesh_brep = MeshBrep(
    Brep=brep,
    Settings={GridMaxCount=0, GridMinCount=16, JaggedSeams=False, MaxEdgeLength=0, MinEdgeLength=0.0001, MinTolerance=0, Refine=True, RefineAngle=0, RelativeTolerance=0.65, SimplePlanes=True, Tolerance=0})
flip_plane = FlipPlane(Plane=xy_plane, ReverseX=False, ReverseY=False, SwapAxes=True)
rotate_plane = RotatePlane(Plane=yz_plane, Angle=degrees(90))
mesh_join = MeshJoin(Meshes=mesh_brep)
create_tool = CreateTool(Name="DefaultGHTool", TCP=rotate_plane, Weight=0, Mesh=mesh_join)  # -> Tool, TCP
list = RobotsLibrary(
    {"AA-KR60", "AA-KR30", "AA-KR60_KR30", "AARCH IRB120", "AARCH IRB6620", "AAU-Utzon-UR10", "Automata", "Franka Emika Panda", "Bartlett-IRB120", "Bartlett-IRB1600"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}, selected="Bartlett-IRB1600",
    Type=0)
create_target = CreateTarget(Plane=flip_plane, Tool=create_tool.Tool, IsCartesian=True)
load_robot_system = LoadRobotSystem(Name=list, Base=PlaneXY(0, 0, 0))
create_program = CreateProgram(Name="DefaultProgram", RobotSystem=load_robot_system, Targets=create_target, StepSize=1)  # -> Program, Code, Duration, Warnings, Errors
panel_2 = Panel(flip_plane)
program_simulation = ProgramSimulation(Program=create_program.Program, Time=Slider(0, range=0..1), Normalized=True)  # -> SystemMeshes, JointRotations, Plane, Index, Time, Program, Errors
deconstruct_program_targets = DeconstructProgramTargets(Program=create_program.Program)  # -> Planes, Joints, Configuration, DeltaTime
panel_3 = Panel(create_program.Code)
list_item_3 = ListItem(List=deconstruct_program_targets.Planes, Index=-1, Wrap=True)  # -> flatten(Item)
custom_preview = CustomPreview(Geometry=program_simulation.SystemMeshes, Material=ColourSwatch(SwatchColor=RGB(125, 125, 125)))
split_list = SplitList(List=list_item_3, Index=program_simulation.Index)  # -> ListA, ListB
panel_4 = Panel(create_target)
polyline_2 = PolyLine(Vertices=split_list.ListA, Closed=False)
